% Simulink data dictionary neck_mk3.sldd

MCU_Ts = 0.001

Data_ControlCommands = Simulink.Bus()
  Voltage: single[3], Min=-100, Max=100, Unit="%"  % Actuation voltage signals.

Data_ControlFeedback = Simulink.Bus()
  Encoders: single[3], Unit="deg"

Data_JointReferences = Simulink.Bus()
  SetPoints: single[3], Unit="deg"  % Setpoints that the system needs to track.

Data_Measurements = Simulink.Bus()
  Encoders: single[3], Unit="deg"

Physical_MotorRotationals = Simulink.ConnectionBus()
  Motor1: Connection: foundation.mechanical.rotational.rotational
  Motor2: Connection: foundation.mechanical.rotational.rotational
  Motor3: Connection: foundation.mechanical.rotational.rotational
  Reference: Connection: foundation.mechanical.rotational.rotational

Physical_JointRotationals = Simulink.ConnectionBus()
  Joint1_Stage1: Connection: foundation.mechanical.rotational.rotational
  Joint1_Stage2: Connection: foundation.mechanical.rotational.rotational
  Joint2_Stage1: Connection: foundation.mechanical.rotational.rotational
  Joint2_Stage2: Connection: foundation.mechanical.rotational.rotational
  Joint3_Stage1: Connection: foundation.mechanical.rotational.rotational
  Joint3_Stage2: Connection: foundation.mechanical.rotational.rotational
  Reference: Connection: foundation.mechanical.rotational.rotational

Physical_MotorPhases = Simulink.ConnectionBus()
  Phase1_Pos: Connection: foundation.electrical.electrical
  Phase2_Pos: Connection: foundation.electrical.electrical
  Phase3_Pos: Connection: foundation.electrical.electrical
  Phase_Neg: Connection: foundation.electrical.electrical

Physical_Environment = Simulink.ConnectionBus()
  World: Connection: simmechanics.connections.frame

Physical_JointMultibody = Simulink.ConnectionBus()
  Joint1_B: Connection: simmechanics.connections.frame
  Joint1_F: Connection: simmechanics.connections.frame
  Joint2_B: Connection: simmechanics.connections.frame
  Joint2_F: Connection: simmechanics.connections.frame
  Joint3_B: Connection: simmechanics.connections.frame
  Joint3_F: Connection: simmechanics.connections.frame

Types_MotorDriver = enum(StorageType="uint8")
  DC_12V = 0

Types_Mechanism = enum(StorageType="uint8")
  Mk2 = 0

Types_Sensing = enum(StorageType="uint8")
  Mk2 = 0

Types_Payload = enum(StorageType="uint8")
  ergoCubHead = 0

Selector_Controller = Simulink.Parameter(Types_Controller.Mk2, DataType="Enum: Types_Controller")
Selector_MotorDriver = Simulink.Parameter(Types_MotorDriver.DC_12V, DataType="Enum: Types_MotorDriver")
Selector_Transmission = Simulink.Parameter(Types_Transmission.Mk2, DataType="Enum: Types_Transmission")
Selector_Mechanism = Simulink.Parameter(Types_Mechanism.Mk2, DataType="Enum: Types_Mechanism")
Selector_Payload = Simulink.Parameter(Types_Payload.ergoCubHead, DataType="Enum: Types_Payload")
Selector_Sensing = Simulink.Parameter(Types_Sensing.Mk2, DataType="Enum: Types_Sensing")

Types_Motor = enum(StorageType="uint8")
  DC_Faulhaber_2342S_012_CR = 0

Selector_Motor = Simulink.Parameter(Types_Motor.DC_Faulhaber_2342S_012_CR, DataType="Enum: Types_Motor")

Types_Transmission = enum(StorageType="uint8")
  Mk2 = 0

Types_Controller = enum(StorageType="uint8")
  Mk2 = 0

Variants = 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