% Simulink data dictionary neck_mk3_serial_data.sldd

mk3_serial_smiData = struct(
  RigidTransform=[struct(translation=[0 0 0], angle=0, axis=[0 0 0], ID="B[IC_033_G_004_asm:61:-:IC_033_G_004_asm:64]"), struct(
    translation=[1.5 -2.220446e-16 0],
    angle=1.570796,
    axis=[-0 -0 -1],
    ID="F[IC_033_G_004_asm:61:-:IC_033_G_004_asm:64]"), struct(translation=[0 0 0], angle=0, axis=[0 0 0], ID="B[IC_033_G_004_asm:61:-:IC_033_G_004_asm:69]"), struct(translation=[0 -9 0], angle=3.141593, axis=[1 0 0], ID="F[IC_033_G_004_asm:61:-:IC_033_G_004_asm:69]"), struct(translation=[0 0 0], angle=0, axis=[0 0 0], ID="B[IC_033_G_004_asm:61:-:IC_033_G_004_asm:74]"), struct(
    translation=[-3.38125 8.881784e-16 0],
    angle=1.570796,
    axis=[-0 -0 -1],
    ID="F[IC_033_G_004_asm:61:-:IC_033_G_004_asm:74]"), struct(
    translation=[0 -0.445 0],
    angle=2.094395,
    axis=[-0.5773503 -0.5773503 -0.5773503],
    ID="B[IC_033_G_004_asm:61:-:IC_033_G_004_asm:77]"), struct(
    translation=[4.249294e-13 1.314504e-13 4.945],
    angle=3.141593,
    axis=[1 -1.182367e-29 -2.129963e-13],
    ID="F[IC_033_G_004_asm:61:-:IC_033_G_004_asm:77]"), struct(translation=[0 0 0], angle=0, axis=[0 0 0], ID="B[IC_033_G_004_asm:61:-:IC_033_G_004_asm:82]"), struct(
    translation=[0 8.881784e-16 -7.2625],
    angle=1.570796,
    axis=[1 0 0],
    ID="F[IC_033_G_004_asm:61:-:IC_033_G_004_asm:82]"), struct(translation=[0 0 0], angle=0, axis=[0 0 0], ID="B[IC_033_G_004_asm:64:-:IC_033_G_004_asm:85]"), struct(
    translation=[-3.944305e-31 4.440892e-16 -3.2],
    angle=2.094395,
    axis=[-0.5773503 -0.5773503 -0.5773503],
    ID="F[IC_033_G_004_asm:64:-:IC_033_G_004_asm:85]"), struct(translation=[0 0 0], angle=0, axis=[0 0 0], ID="B[IC_033_G_004_asm:74:-:IC_033_G_004_asm:82]"), struct(
    translation=[0 8.881784e-16 -3.88125],
    angle=2.094395,
    axis=[0.5773503 -0.5773503 0.5773503],
    ID="F[IC_033_G_004_asm:74:-:IC_033_G_004_asm:82]"), struct(translation=[0 0 0], angle=0, axis=[0 0 0], ID="B[IC_033_G_004_asm:85:-:IC_033_G_004_asm:88]"), struct(
    translation=[6.656014e-31 1.221245e-15 -0.5],
    angle=1.069763e-15,
    axis=[-0 4.608853e-17 -1],
    ID="F[IC_033_G_004_asm:85:-:IC_033_G_004_asm:88]"), struct(translation=[0 0 0], angle=0, axis=[0 0 0], ID="B[1110:-:1442]"), struct(
    translation=[0.2 8.016184e-16 -7.534771e-18],
    angle=1.178097,
    axis=[1 -4.519934e-17 -4.519934e-17],
    ID="F[1110:-:1442]"), struct(translation=[14.75 0 0], angle=2.094395, axis=[0.5773503 0.5773503 0.5773503], ID="B[1110:-:1631]"), struct(
    translation=[14.75 9.065124e-14 -4.095596e-13],
    angle=2.094395,
    axis=[-0.5773503 -0.5773503 0.5773503],
    ID="F[1110:-:1631]"), struct(translation=[0 0 0], angle=0, axis=[0 0 0], ID="B[7716:-:1110]"), struct(
    translation=[7 -4.270982e-17 -1.503498e-16],
    angle=1.884578,
    axis=[-0.4856527 0.7268307 -0.4856527],
    ID="F[7716:-:1110]"), struct(translation=[0 0 0], angle=0, axis=[0 0 0], ID="B[2189:-:5678]"), struct(
    translation=[23.25 26.5 -6],
    angle=2.094395,
    axis=[-0.5773503 -0.5773503 0.5773503],
    ID="F[2189:-:5678]"), struct(translation=[0 0 0], angle=0, axis=[0 0 0], ID="B[2189:-:5681]"), struct(
    translation=[23.25 33.7 -6],
    angle=2.094395,
    axis=[-0.5773503 -0.5773503 0.5773503],
    ID="F[2189:-:5681]"), struct(translation=[0 0 0], angle=0, axis=[0 0 0], ID="B[2189:-:5682]"), struct(translation=[26.5 23.25 -14], angle=1.570796, axis=[1 -1.78382e-14 -1.797756e-14], ID="F[2189:-:5682]"), struct(translation=[0 0 0], angle=0, axis=[0 0 0], ID="B[2189:-:5683]"), struct(
    translation=[33.7 23.25 -14],
    angle=1.570796,
    axis=[1 -1.783815e-14 -1.797756e-14],
    ID="F[2189:-:5683]"), struct(translation=[0 0 0], angle=0, axis=[0 0 0], ID="B[8081:-:3585]"), struct(
    translation=[0 -2.710505e-17 42],
    angle=1.570796,
    axis=[8.482597e-17 -2.889766e-17 -1],
    ID="F[8081:-:3585]"), struct(translation=[0 0 0], angle=0, axis=[0 0 0], ID="B[13815:-:4233]"), struct(translation=[-20.15 45 10], angle=1.570796, axis=[7.850462e-17 -7.850462e-17 1], ID="F[13815:-:4233]"), struct(translation=[0 0 0], angle=0, axis=[0 0 0], ID="B[13815:-:4693]"), struct(translation=[2.85 45 10], angle=1.570796, axis=[7.850462e-17 -7.850462e-17 1], ID="F[13815:-:4693]"), struct(translation=[0 0 0], angle=0, axis=[0 0 0], ID="B[5678:-:5682]"), struct(
    translation=[-3.552714e-15 5.04871e-29 -20],
    angle=3.141593,
    axis=[-0.7071068 -0.7071068 5.551115e-17],
    ID="F[5678:-:5682]"), struct(translation=[0 0 0], angle=0, axis=[0 0 0], ID="B[5681:-:5683]"), struct(
    translation=[-3.552714e-15 1.009742e-28 -20],
    angle=3.141593,
    axis=[-0.7071068 -0.7071068 5.551115e-17],
    ID="F[5681:-:5683]")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],
  Solid=[struct(
    mass=0.07316045,
    CoM=[-4.897117 -8.162919 -24.04892],
    MoI=[52.33927 50.07478 22.61876],
    PoI=[11.24321 -5.8073 1.912915],
    color=[0.5 0.5 0.5],
    opacity=1,
    ID="HESN0001_prt"), struct(
    mass=0.0001503171,
    CoM=[0 0 3],
    MoI=[0.0004796175 0.0004796176 7.445015e-05],
    PoI=[0 0 0],
    color=[0.5 0.5 0.5],
    opacity=1,
    ID="S2-6--_-_I2338_B_prt"), struct(
    mass=0.01191153,
    CoM=[14.74635 0 0],
    MoI=[1.956883 0.9861832 1.010202],
    PoI=[-0.01200987 0 0],
    color=[0.5 0.5 0.5],
    opacity=1,
    ID="HFUC-8-100-2A-R_A_prt"), struct(
    mass=0.00390231,
    CoM=[-14.10656 2.432434 5.904362],
    MoI=[0.5264079 0.9283091 0.9482278],
    PoI=[-0.03305887 0.2651124 0.08846275],
    color=[0.5 0.5 0.5],
    opacity=1,
    ID="HESN0011_prt"), struct(
    mass=0.06570952,
    CoM=[0.0135092 -1.387744 -8.141787],
    MoI=[7.122016 5.630145 9.461426],
    PoI=[0.08818543 0.004396174 0.01993137],
    color=[0.5 0.5 0.5],
    opacity=1,
    ID="FAULHABER_3216W024BXTH_prt"), struct(
    mass=0.0002260105,
    CoM=[0 0 -0.4662976],
    MoI=[0.0006828573 0.0006828577 0.0003035176],
    PoI=[0 0 0],
    color=[0.5 0.5 0.5],
    opacity=1,
    ID="M2X04-6LOBE-ISO14583-A2-70_prt"), struct(
    mass=0.0008362587,
    CoM=[11.29905 -0.01863877 -0.01863874],
    MoI=[0.004761515 0.02388759 0.02388759],
    PoI=[7.534628e-07 -0.0001313041 -0.0001313043],
    color=[0.5 0.5 0.5],
    opacity=1,
    ID="HESN0007_prt"), struct(
    mass=0.004324205,
    CoM=[-0.1180034 -0.1180027 3.841728],
    MoI=[0.2626521 0.2626522 0.4987564],
    PoI=[0.001594874 0.001594881 6.030541e-05],
    color=[0.5 0.5 0.5],
    opacity=1,
    ID="IC_033_P_003_prt"), struct(
    mass=0.013,
    CoM=[0 0 1.5],
    MoI=[0.1195682 0.1195683 0.2244276],
    PoI=[0 0 0],
    color=[0.5 0.5 0.5],
    opacity=1,
    ID="627-6-2Z_prt"), struct(
    mass=0.001353231,
    CoM=[0 0 -0.01931882],
    MoI=[0.03469017 0.03469018 0.06915962],
    PoI=[0 0 0],
    color=[0.5 0.5 0.5],
    opacity=1,
    ID="HESN0010_prt"), struct(
    mass=6.071981e-05,
    CoM=[0 0 0.9957581],
    MoI=[6.392706e-05 6.392707e-05 4.296482e-05],
    PoI=[0 0 0],
    color=[0.5 0.5 0.5],
    opacity=1,
    ID="V1_6-3--_-_ISO7046-1_CH_prt"), struct(
    mass=0.0001226814,
    CoM=[0 0 0.25],
    MoI=[0.0004567838 0.0004567837 0.0009084557],
    PoI=[0 0 0],
    color=[0.5 0.5 0.5],
    opacity=1,
    ID="R3--_-_U6592_prt"), struct(
    mass=0.01179477,
    CoM=[15.34586 -0.002140098 0.002243917],
    MoI=[0.3899513 0.2718532 0.2718551],
    PoI=[0 0.0001484174 -0.0001479631],
    color=[0.5 0.5 0.5],
    opacity=1,
    ID="HFUC-8-100-2A-R_B_prt"), struct(
    mass=0.0004245589,
    CoM=[0 0 -3.954959],
    MoI=[0.007675089 0.00767509 0.000402792],
    PoI=[0 0 0],
    color=[0.5 0.5 0.5],
    opacity=1,
    ID="M2X12-6LOBE-ISO14583-A2-70_prt"), struct(
    mass=0.00122549,
    CoM=[0 0 -9.631867],
    MoI=[0.08711951 0.08711953 0.00156833],
    PoI=[0 0 -3.774256e-08],
    color=[0.5 0.5 0.5],
    opacity=1,
    ID="M2_5X25-6LOBE-ISO14583-A2-70_prt"), struct(
    mass=0.0001402905,
    CoM=[0 0 0.8],
    MoI=[0.0002096527 0.0002096528 0.0003635125],
    PoI=[0 0 0],
    color=[0.5 0.5 0.5],
    opacity=1,
    ID="D2_5--_-_I4032_prt"), struct(
    mass=0.02000019,
    CoM=[-4.025677 -2.872114 2.211097],
    MoI=[1.566921 3.538054 2.572791],
    PoI=[0.07641121 0.4527776 -0.1391193],
    color=[0.5 0.5 0.5],
    opacity=1,
    ID="IC_033_P_001_prt"), struct(
    mass=0.0005513495,
    CoM=[0 1.25 0],
    MoI=[0.001527698 0.002481073 0.001527698],
    PoI=[0 0 0],
    color=[0.5 0.5 0.5],
    opacity=1,
    ID="MAGNET6MM_prt"), struct(
    mass=0.005591022,
    CoM=[0 0 3.904394],
    MoI=[1.069368 1.069368 2.118808],
    PoI=[0 0 0],
    color=[0.5 0.5 0.5],
    opacity=1,
    ID="IC_033_P_002_prt"), struct(
    mass=0.01185233,
    CoM=[0 0 0],
    MoI=[2.768222 1.403539 1.403539],
    PoI=[0 0 0],
    color=[0.5 0.5 0.5],
    opacity=1,
    ID="KAA10XL0_prt"), struct(
    mass=0.004760683,
    CoM=[0 0 0],
    MoI=[0.409663 0.4096628 0.8121848],
    PoI=[0 0 0],
    color=[0.5 0.5 0.5],
    opacity=1,
    ID="HESN0015_prt"), struct(
    mass=0.004467658,
    CoM=[6.753466 0 0],
    MoI=[0.3012443 0.2896632 0.2941252],
    PoI=[0 0 0],
    color=[0.5 0.5 0.5],
    opacity=1,
    ID="HFUC-8-100-2A-R_C_prt"), struct(
    mass=0.0007787451,
    CoM=[0 0 0],
    MoI=[0.007973536 0.00797354 0.01581729],
    PoI=[0 0 0],
    color=[0.5 0.5 0.5],
    opacity=1,
    ID="4_3X12X1-ISO7093-A2_prt"), struct(
    mass=0.001555595,
    CoM=[0 0 -1.274903],
    MoI=[0.01888381 0.01888382 0.006534698],
    PoI=[0 0 0],
    color=[0.5 0.5 0.5],
    opacity=1,
    ID="M4X08-6LOBE-ISO14580-A2-70_prt"), struct(
    mass=0.0003828164,
    CoM=[0 0 -6.327414],
    MoI=[0.007160615 0.007160615 0.0002624621],
    PoI=[0 0 0],
    color=[0.5 0.5 0.5],
    opacity=1,
    ID="M2X14-6LOBE-ISO14581-A2-70_prt"), struct(
    mass=0.04324657,
    CoM=[0 -0.4183155 8.243423],
    MoI=[6.904909 12.50866 17.31092],
    PoI=[-0.009548027 0 0],
    color=[0.5 0.5 0.5],
    opacity=1,
    ID="IC_033_P_004_prt"), struct(
    mass=0.01047046,
    CoM=[-7.799818 0.346683 4.233979],
    MoI=[0.7735311 2.278505 1.58624],
    PoI=[0.01536894 0.2862917 -0.02831257],
    color=[0.5 0.5 0.5],
    opacity=1,
    ID="IC_033_P_006_prt"), struct(
    mass=0.01451615,
    CoM=[-19.2652 -2.573123 -3.933072],
    MoI=[1.185574 4.985652 5.139857],
    PoI=[-0.1644595 -1.306555 -0.5793608],
    color=[0.5 0.5 0.5],
    opacity=1,
    ID="IC_033_P_005_prt"), struct(
    mass=0.014,
    CoM=[0 0 3],
    MoI=[0.4602746 0.4602745 0.8554789],
    PoI=[0 0 0],
    color=[0.5 0.5 0.5],
    opacity=1,
    ID="619-9-2Z_prt"), struct(
    mass=0.003243263,
    CoM=[0 0 -9.120565],
    MoI=[0.2452917 0.2452918 0.009910035],
    PoI=[0 0 0],
    color=[0.5 0.5 0.5],
    opacity=1,
    ID="M4X25-6LOBE-ISO14580-A2-70_prt"), struct(
    mass=0.004205832,
    CoM=[-22.32882 -2.841614 9.004286],
    MoI=[0.3786312 1.406045 1.415314],
    PoI=[0.05252024 0.4305498 -0.1562332],
    color=[0.5 0.5 0.5],
    opacity=1,
    ID="IC_033_P_007_prt"), struct(
    mass=2.598072e-05,
    CoM=[-1.5 0 0],
    MoI=[2.356765e-05 2.873403e-05 2.873406e-05],
    PoI=[0 0 0],
    color=[0.5 0.5 0.5],
    opacity=1,
    ID="MINI-TECH_MTEC-B-M1_6_prt"), struct(
    mass=0.001857981,
    CoM=[0 -0.3016967 2.433743],
    MoI=[0.09101077 0.09819324 0.1690116],
    PoI=[0.002466513 0 0],
    color=[0.5 0.5 0.5],
    opacity=1,
    ID="IC_033_P_008_prt"), struct(
    mass=0.001031594,
    CoM=[0 0 -7.230573],
    MoI=[0.0490408 0.04904083 0.001416848],
    PoI=[0 0 -3.326155e-08],
    color=[0.5 0.5 0.5],
    opacity=1,
    ID="M2_5X20-6LOBE-ISO14583-A2-70_prt"), struct(
    mass=0.001489208,
    CoM=[0 0 -11.65384],
    MoI=[0.08586384 0.08586385 0.002090944],
    PoI=[0 0 0],
    color=[0.5 0.5 0.5],
    opacity=1,
    ID="M3X25-6LOBE-ISO14581-A2-70_prt"), struct(
    mass=0.001209999,
    CoM=[0 0 -9.176643],
    MoI=[0.04551594 0.04551594 0.001776834],
    PoI=[0 0 0],
    color=[0.5 0.5 0.5],
    opacity=1,
    ID="M3X20-6LOBE-ISO14581-A2-70_prt"), struct(
    mass=0.01204042,
    CoM=[31.34104 0 23.43634],
    MoI=[2.061537 5.483698 3.901141],
    PoI=[0 2.078763 0],
    color=[0.5 0.5 0.5],
    opacity=1,
    ID="HESN0003_prt"), struct(
    mass=0.01027005,
    CoM=[-0.3756551 0 11.50025],
    MoI=[0.5885978 0.5640007 0.2854432],
    PoI=[0 -0.0007725927 0],
    color=[0.5 0.5 0.5],
    opacity=1,
    ID="HESN0004_prt"), struct(
    mass=0.02891397,
    CoM=[0 -1.169453 -6.983599],
    MoI=[1.737856 1.413794 1.983309],
    PoI=[0.0569696 0 0],
    color=[0.5 0.5 0.5],
    opacity=1,
    ID="2214_BXTH_prt")],
  CylindricalJoint=struct(Rz=struct(Pos=3.753055e-13), Pz=struct(Pos=0), ID="[78:-:7848:77]"),
  RevoluteJoint=[struct(Rz=struct(Pos=-3.199638e-12), ID="[7848:61:-:7848:77]"), struct(Rz=struct(Pos=22.5), ID="[1110:-:1631]"), struct(Rz=struct(Pos=90), ID="[78:-:7848:74]"), struct(Rz=struct(Pos=0), ID="[229:-:407]")])