# Requirement set neck_functional_requirements (R2023b)

## 1 [NeckFR_1] Sensing (Container)

### 1.1 [NeckFR_2] Disambiguate kinematic configurations from sensor readings
We shall be always able to reconstruct the kinematic configuration of the mechanism univocally.
This means that the sensors shall be mounted on the structure accordingly to provide suitable readings that help to disambiguate any possible configuration.
Rationale: An example that we aim to prevent from striking and disrupting our efforts.
- We use an absolute sensing system (e.g., AEA sensors)
- However, the sensors may be subject to multiturns behaviors.
- As a result, we lose the possibility to disambiguate kinematic configurations from the sensor readings.

### 1.2 [NeckFR_5] Vision Accuracy
The absolute sensing must guarantee high accuracy of 3D reconstruction of the world through the vision system.
In particular, any possible impairment (e.g., backlash) must be measured and thus taken into account by the high-level vision algorithms.

## 2 [NeckFR_3] Kinematics (Container)

### 2.1 [NeckFR_4] Gazing for Grasping on a table
The neck shall guarantee the functionalities required by a successful grasping action.
For verification purposes, one can refer to https://github.com/robotology/icub-gazebo-grasping-sandbox.

### 2.2 [NeckFR_7] Range of motion
The range of motion of the neck shall not be lower than the current range.
- Pitch: [-45 22] deg
- Roll: [-20 20] deg
- Yaw: [-45 45] deg
- udhdu

### 2.3 [NeckFR_8] Degrees of Freedom (Informational)
The neck shall be endowed with 3 DoFs in this kinematic order:
1. Pitch
2. Roll
3. Yaw

### 2.4 [NeckFR_9] Reachable velocity
We shall reach these peak velocities per joint:
- Pitch: 200 deg/s
- Roll: 200 deg/s
- Yaw: 200 deg/s
We shall reach these average velocities per joint:
- Pitch: 100 deg/s
- Roll: 100 deg/s
- Yaw: 100 deg/s
Rationale: We determined these velocity bounds experimentally.
See https://github.com/icub-tech-iit/study-icub-headedge/issues/30.

### 2.5 [NeckFR_19] Home Position aligned with Gravity
In the home position where the joints are all zeroed, the head must be aligned along the gravity.

## 3 [NeckFR_6] Tendonless (Informational)
The mechanism shall be tendonless

## 4 [NeckFR_10] Payload (Container)

### 4.1 [NeckFR_11] Current iCub head payload
The current iCub head payload is....

### 4.2 [NeckFR_12] Current ergoCub head payload
The current ergoCub head payload is....

### 4.3 [NeckFR_13] ergoCub head with eyes
The ergoCub + eyes head payload is ....

### 4.4 [NeckFR_14] Head 4K payload (comexpress + gpu)
The Head 4K payload is ...

### 4.5 [NeckFR_15] iCub head with only gpu
The iCub head mounting only .... GPU has ... of payload

## 5 [NeckFR_16] Dynamics (Container)

### 5.1 [NeckFR_17] Nominal torque
The neck shall have these nominal torques for:
- pitch -> TBD
- roll -> TBD
- yaw -> TBD

### 5.2 [NeckFR_18] Peak torque
The neck shall have these peak torques for:
- pitch -> TBD
- roll -> TBD
- yaw -> TBD