% Requirement links of neck_functional_requirements.slreqx (R2024a)

#11 refines neck_stakeholder_needs.slreqx#18
#12 refines neck_stakeholder_needs.slreqx#18
#13 refines neck_stakeholder_needs.slreqx#5
#17 relates to neck_mk3.sldd: Design.Req_Caps_Motor_Currents
#18 relates to neck_mk3.sldd: Design.Req_Caps_Motor_Torques
#18 relates to neck_mk3.sldd: Design.Req_Caps_Transmission_Torques
#20 relates to neck_mk3.sldd: Design.Req_Caps_Motor_Velocity
#20 relates to neck_mk3.sldd: Design.Req_Caps_Transmission_Velocity
#7 relates to neck_mk3.sldd: Design.Req_DOF_Bounds
#7 relates to neck_mk3.sldd: Design.Req_Control_SettlingTime
#7 refines neck_stakeholder_needs.slreqx#8
#8 refines neck_stakeholder_needs.slreqx#10
#9 relates to neck_mk3.sldd: Design.Req_Velocity_Peak
#9 relates to neck_mk3.sldd: Design.Req_Velocity_Avg
#9 refines neck_stakeholder_needs.slreqx#7