# Requirement set neck_stakeholder_needs (R2023b)

## 1 [NeckSN_1] Robustness against disturbances (Container)
The neck shall be robust enough not to break or suffer from failures (snapped tendons) under several circumstances:
- ❗FIXME: the neck breaks or the tendons snap out even if in idle.
- walking.
- flying (iRonCub).

### 1.1 [NeckSN_2] Robustness against "whiplash"
"Whiplash" is a particular phenomenon that takes place when abrupt movements of the torso get amplified at the level of the neck.
One relevant example:
- during walking, one motor goes into hardware fault, the robot falls down (most of the time is attached to the crane) and the whiplash occurs.
❗FIXME: add a link to the issue

### 1.2 [NeckSN_3] Robustness against vibrations
Because of the tendons and the flexibility of the actuation, when the robot is walking, the head oscillates. Therefore, it would be good to have a mechanism that reduces the vibrations.
❗FIXME: add the link to the issue/video.

## 2 [NeckSN_4] Payload
We shall have some satefy margin on the payload.

### 2.1 [NeckSN_18] Standard payloads
The neck shall be capable of driving the iCub head and the ergoCub head in their present configurations.

### 2.2 [NeckSN_5] ergoCub with eyes
It is convenient to have a suitable margin for future developments. For example, equipping the ergoCub head with moving eye bulbs.

### 2.3 [NeckSN_15] CPU in the torso (Informational)
Evaluate the possibility to move the COM-Express Type10 in the torso (iCub only).
Rationale: This way we can make iCub head lighter.

## 3 [NeckSN_6] Aesthetics
The neck shall fit well the size of the torso and the head.

## 4 [NeckSN_7] Backdrivability
⚠CHECKME
The neck shall be backdrivable.

## 5 [NeckSN_8] Kinematics (Container)

### 5.1 [NeckSN_9] Range of motion
The range of motion of the neck shall not be lower than the current range.
- Pitch: [-45 22] deg
- Roll: [-20 20] deg
- Yaw: [-45 45] deg

### 5.2 [NeckSN_10] Degrees of Freedom
The neck shall be endowed with 3 DoFs in this kinematic order:
1. Pitch
2. Roll
3. Yaw
This order is warmly recommended but not strictly mandatory. Any change in the order will impact the high-level software (aka gaze controller) and thus entails a careful review.

### 5.3 [NeckSN_11] Reachable velocity
The angular velocity of the head (the payload of the neck) shall reach at least ❗FIXME deg/s.

### 5.4 [NeckSN_12] Serial equivalence
Whatever kinematic structure we will come up with, we shall guarantee that it is serializable, meaning there must exist an equivalent serial kinematic chain representing the entire set of attainable movements.
This need stems from the struggle we paid at the high level to deal with the torso and wrist mechanisms of R1, which were not serializable.
Remarkably, it was asked to apply the same requirement in the past to the development of the wrist-mk2.x of ergoCub.

## 6 [NeckSN_13] Maintenance (Container)

### 6.1 [NeckSN_14] Ease of maintenance
The neck shall expose ease access to perform maintenance / repairments.

## 7 [NeckSN_16] Variants (Container)

### 7.1 [NeckSN_17] Tendonless serial mechanism (Informational)
The design process must consider a tendonless serial mechanism as a baseline.