test file "test_req"

suite "Test Neck Mk2 ergoCub"

  case "Test Range of Motion (ROM)" [simulation]
    model arch_logical, harness arch_logical_Harness_ReqTest_FR_7, variant configuration Variant_NeckMk2_ergoCub
    post-load callback:
      sltest.harness.open(sltest_sut, sltest_bdroot);
    cleanup callback:
      run_mech_explorer("Variant_NeckMk2_ergoCub", "hidden");

  case "Test Home Configuration Alignment" [simulation]
    model arch_logical, harness arch_logical_Harness_ReqTest_FR_19, variant configuration Variant_NeckMk2_ergoCub
    post-load callback:
      sltest.harness.open(sltest_sut, sltest_bdroot);
    cleanup callback:
      run_mech_explorer("Variant_NeckMk2_ergoCub", "hidden");

  case "Test High Performance" [simulation]
    model arch_logical, harness arch_logical_Harness_ReqTest_HighPerformance, variant configuration Variant_NeckMk2_ergoCub
    parameter set "Parameter Set 1":
      Req_Control_SettlingTime = 0.8  % neck_mk3.sldd
      Req_Velocity_Peak = [160;100;200]  % neck_mk3.sldd
      Req_Caps_Motor_Currents = [1.4; 1.4; 1.4]  % neck_mk3.sldd
      Req_Caps_Motor_Torques = [16; 16; 16]  % neck_mk3.sldd
      Req_Caps_Motor_Velocity = [7000; 7000; 7000]  % neck_mk3.sldd
      Req_Caps_Transmission_Torques = [2.4; 2.4; 2.4]  % neck_mk3.sldd
      Req_Caps_Transmission_Velocity = [85; 85; 85]  % neck_mk3.sldd
      T = 0.4  % mask workspace, arch_logical/MCU/Planner/Planner MinJerk/Minimum Jerk
      Param_Planner_MinJerk_ReactionTime = 0.4  % neck_mk3.sldd
    post-load callback:
      sltest.harness.open(sltest_sut, sltest_bdroot);
    cleanup callback:
      run_mech_explorer("Variant_NeckMk2_ergoCub", "hidden");

suite "Test Neck Mk3 Serial ergoCub"

  case "Test Range of Motion (ROM)" [simulation]
    model arch_logical, harness arch_logical_Harness_ReqTest_FR_7, variant configuration Variant_NeckMk3_Serial_ergoCub
    post-load callback:
      sltest.harness.open(sltest_sut, sltest_bdroot);
    cleanup callback:
      run_mech_explorer("Variant_NeckMk3_Serial_ergoCub", "hidden");

  case "Test Home Configuration Alignment" [simulation]
    model arch_logical, harness arch_logical_Harness_ReqTest_FR_19, variant configuration Variant_NeckMk3_Serial_ergoCub
    post-load callback:
      sltest.harness.open(sltest_sut, sltest_bdroot);
    cleanup callback:
      run_mech_explorer("Variant_NeckMk3_Serial_ergoCub", "hidden");

  case "Test High Performance" [simulation]
    model arch_logical, harness arch_logical_Harness_ReqTest_HighPerformance, variant configuration Variant_NeckMk3_Serial_ergoCub
    parameter set "Parameter Set 1":
      Req_Control_SettlingTime = 0.8  % neck_mk3.sldd
      Req_Velocity_Peak = [160;160;200]  % neck_mk3.sldd
      Req_Caps_Motor_Currents = [1.1; 1.1; 0.36]  % neck_mk3.sldd
      Req_Caps_Motor_Torques = [38; 38; 9.7]  % neck_mk3.sldd
      Req_Caps_Motor_Velocity = [4320; 4320; 2710]  % neck_mk3.sldd
      Req_Caps_Transmission_Torques = [2.4; 2.4; 2.4]  % neck_mk3.sldd
      Req_Caps_Transmission_Velocity = [85; 85; 85]  % neck_mk3.sldd
      T = 0.4  % mask workspace, arch_logical/MCU/Planner/Planner MinJerk/Minimum Jerk
      Param_Planner_MinJerk_ReactionTime = 0.4  % neck_mk3.sldd
    post-load callback:
      sltest.harness.open(sltest_sut, sltest_bdroot);
    cleanup callback:
      run_mech_explorer("Variant_NeckMk3_Serial_ergoCub", "hidden");

suite "Test Neck Mk2 iCub"

  case "Test Range of Motion (ROM)" [simulation]
    model arch_logical, harness arch_logical_Harness_ReqTest_FR_7, variant configuration Variant_NeckMk2_iCub
    post-load callback:
      sltest.harness.open(sltest_sut, sltest_bdroot);
    cleanup callback:
      run_mech_explorer("Variant_NeckMk2_iCub", "hidden");

  case "Test Home Configuration Alignment" [simulation]
    model arch_logical, harness arch_logical_Harness_ReqTest_FR_19, variant configuration Variant_NeckMk2_iCub
    post-load callback:
      sltest.harness.open(sltest_sut, sltest_bdroot);
    cleanup callback:
      run_mech_explorer("Variant_NeckMk2_iCub", "hidden");

  case "Test High Performance" [simulation]
    model arch_logical, harness arch_logical_Harness_ReqTest_HighPerformance, variant configuration Variant_NeckMk2_iCub
    parameter set "Parameter Set 1":
      Req_Control_SettlingTime = 0.8  % neck_mk3.sldd
      Req_Velocity_Peak = [160;100;200]  % neck_mk3.sldd
      Req_Caps_Motor_Currents = [1.4; 1.4; 1.4]  % neck_mk3.sldd
      Req_Caps_Motor_Torques = [16; 16; 16]  % neck_mk3.sldd
      Req_Caps_Motor_Velocity = [7000; 7000; 7000]  % neck_mk3.sldd
      Req_Caps_Transmission_Torques = [2.4; 2.4; 2.4]  % neck_mk3.sldd
      Req_Caps_Transmission_Velocity = [85; 85; 85]  % neck_mk3.sldd
      T = 0.4  % mask workspace, arch_logical/MCU/Planner/Planner MinJerk/Minimum Jerk
      Param_Planner_MinJerk_ReactionTime = 0.4  % neck_mk3.sldd
    post-load callback:
      sltest.harness.open(sltest_sut, sltest_bdroot);
    cleanup callback:
      run_mech_explorer("Variant_NeckMk2_iCub", "hidden");

suite "Test Neck Mk3 Serial iCub"

  case "Test Range of Motion (ROM)" [simulation]
    model arch_logical, harness arch_logical_Harness_ReqTest_FR_7, variant configuration Variant_NeckMk3_Serial_iCub
    post-load callback:
      sltest.harness.open(sltest_sut, sltest_bdroot);
    cleanup callback:
      run_mech_explorer("Variant_NeckMk3_Serial_iCub", "hidden");

  case "Test Home Configuration Alignment" [simulation]
    model arch_logical, harness arch_logical_Harness_ReqTest_FR_19, variant configuration Variant_NeckMk3_Serial_iCub
    post-load callback:
      sltest.harness.open(sltest_sut, sltest_bdroot);
    cleanup callback:
      run_mech_explorer("Variant_NeckMk3_Serial_iCub", "hidden");

  case "Test High Performance" [simulation]
    model arch_logical, harness arch_logical_Harness_ReqTest_HighPerformance, variant configuration Variant_NeckMk3_Serial_iCub
    parameter set "Parameter Set 1":
      Req_Control_SettlingTime = 0.8  % neck_mk3.sldd
      Req_Velocity_Peak = [160;160;200]  % neck_mk3.sldd
      Req_Caps_Motor_Currents = [1.1; 1.1; 0.36]  % neck_mk3.sldd
      Req_Caps_Motor_Torques = [38; 38; 9.7]  % neck_mk3.sldd
      Req_Caps_Motor_Velocity = [4320; 4320; 2710]  % neck_mk3.sldd
      Req_Caps_Transmission_Torques = [2.4; 2.4; 2.4]  % neck_mk3.sldd
      Req_Caps_Transmission_Velocity = [85; 85; 85]  % neck_mk3.sldd
      T = 0.4  % mask workspace, arch_logical/MCU/Planner/Planner MinJerk/Minimum Jerk
      Param_Planner_MinJerk_ReactionTime = 0.4  % neck_mk3.sldd
    post-load callback:
      sltest.harness.open(sltest_sut, sltest_bdroot);
    cleanup callback:
      run_mech_explorer("Variant_NeckMk3_Serial_iCub", "hidden");