% Requirement links of test_req.mldatx (R2024a)

item 1 verifies neck_functional_requirements.slreqx#9
item 1 verifies neck_functional_requirements.slreqx#17
item 1 verifies neck_functional_requirements.slreqx#18
item 1 verifies neck_functional_requirements.slreqx#20
item 2 verifies neck_functional_requirements.slreqx#7: NeckFR_7 Range of motion
item 2 verifies neck_functional_requirements.slreqx#11: NeckFR_11 Current iCub head payload
item 2 verifies neck_functional_requirements.slreqx#12: NeckFR_12 Current ergoCub head payload
item 3 verifies neck_functional_requirements.slreqx#19: NeckFR_19 Home Configuration aligned with Gravity
item 4 verifies neck_functional_requirements.slreqx#7
item 4 verifies neck_functional_requirements.slreqx#11
item 4 verifies neck_functional_requirements.slreqx#12
item 5 verifies neck_functional_requirements.slreqx#9: NeckFR_9 Reachable velocity
item 5 verifies neck_functional_requirements.slreqx#17: NeckFR_17 Current Caps
item 5 verifies neck_functional_requirements.slreqx#18: NeckFR_18 Torque Caps
item 5 verifies neck_functional_requirements.slreqx#20: NeckFR_14 Velocity Caps
item 6 verifies neck_functional_requirements.slreqx#19